# Grasshopper definition non_planar.gh (Grasshopper 1.0.8)
# plug-ins: KUKA|prc - parametric robot control

geo = Geometry([<brep referenced from the Rhino model> x19])
mesh = MeshBrep(
    Brep=geo,
    Settings={GridMaxCount=0, GridMinCount=16, JaggedSeams=False, MaxEdgeLength=0, MinEdgeLength=0.0001, MinTolerance=0, Refine=True, RefineAngle=0, RelativeTolerance=0.65, SimplePlanes=True, Tolerance=0})
mjoin = MeshJoin(Meshes=mesh)
custom_tool = CustomToolKUKAPrc(
    CustomToolGeometry=mjoin,
    isExternal=False,
    toolid=14,
    toolvala=0,
    toolvalb=0,
    toolvalc=0,
    toolvalx=437.214,
    toolvaly=0,
    toolvalz=95.214,
    valuesset=True)
kr30_60 = KR3060HARobot(infiniterot=False)
py3 = Python3Script()  # -> out, a, b, c, d
# ---------- py3: Python ----------
import Rhino.Geometry as rg
import math

# === CONFIG ===
x_global   = 1500.0
y_global   = 0.0
z_global   = 890.0
clearance  = 10.0
radio      = 150.0
num_pts    = 200
speed      = 0.05
layer_h    = 20.0
num_layers = 20

# === PARAMETROS NON-PLANAR ===
pattern         = "wave"
freq            = 4
amplitude_max   = 10.0   # mm maxima variacion Z
planar_layers   = 2      # cuantas capas base planas
transition_layers = 2    # capas donde crece gradualmente

all_planes = []
all_pts    = []
all_curves = []

for layer in range(num_layers):
    pts_3d = []

    # === CALCULAR AMPLITUD SEGUN CAPA ===
    if layer < planar_layers:
        # Completamente plano
        amplitude = 0.0

    elif layer < planar_layers + transition_layers:
        # Crece gradualmente 0 -> amplitude_max
        t_transition = (layer - planar_layers) / transition_layers
        amplitude = amplitude_max * t_transition

    else:
        # Full non-planar
        amplitude = amplitude_max

    for i in range(num_pts + 1):
        t = 2 * math.pi * i / num_pts

        px = x_global + radio * math.cos(t)
        py = y_global + radio * math.sin(t)

        # Z offset segun patron y amplitud actual
        if pattern == "wave":
            z_offset = amplitude * math.sin(freq * t)
        elif pattern == "cone":
            z_offset = amplitude * (t / (2 * math.pi))
        elif pattern == "saddle":
            z_offset = amplitude * math.cos(2 * t)
        elif pattern == "spiral":
            z_offset = amplitude * (t / (2 * math.pi))
        else:
            z_offset = 0.0

        z = z_global + clearance + layer * layer_h + z_offset

        pt = rg.Point3d(px, py, z)
        pts_3d.append(pt)
        all_pts.append(pt)

        # === PLANO ===
        # Para capas planas -> ZAxis normal
        # Para non-planar -> inclinado segun tangente

        if amplitude < 0.5:
            # Plano normal apuntando abajo
            pl = rg.Plane(pt, rg.Vector3d.XAxis, rg.Vector3d.YAxis)
        else:
            # Calcular tangente real
            t_next  = 2 * math.pi * (i + 1) / num_pts
            px_next = x_global + radio * math.cos(t_next)
            py_next = y_global + radio * math.sin(t_next)

            if pattern == "wave":
                z_next_offset = amplitude * math.sin(freq * t_next)
            elif pattern == "saddle":
                z_next_offset = amplitude * math.cos(2 * t_next)
            else:
                z_next_offset = amplitude * (t_next / (2 * math.pi))

            z_next = z_global + clearance + layer * layer_h + z_next_offset

            tangent = rg.Vector3d(px_next - px, py_next - py, z_next - z)
            tangent.Unitize()

            normal = rg.Vector3d(x_global - px, y_global - py, 0)
            normal.Unitize()

            pl = rg.Plane(pt, tangent, normal)

        all_planes.append(pl)

    if len(pts_3d) >= 2:
        poly = rg.Polyline(pts_3d)
        all_curves.append(poly.ToNurbsCurve())

a = all_curves
b = all_planes
c = all_pts
d = speed
# ---------- end py3 ----------
lin_move = LINearMovementKUKAPrc(TargetAsPlane=py3.b, extaxenabled=False, interpolation="C_DIS")
kuka_prc = KUKAPrcCORE(
    SimulationSlider=Slider(0, range=0..1),
    KUKAPrcCommands=lin_move,
    Tool=custom_tool,
    Robot=kr30_60,
    PRC_BaseExpose=False,
    PRC_SaveNameExpose=False,
    PRCsettings="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")  # -> RobotGeometry, AnalysisOutput
